# Grasshopper definition grasshopper data representation.gh (Grasshopper 1.0.7)

python = GhPythonScript()  # -> out, v_list
# ---------- python: Python ----------
v_list = [[[769, 79.511959270184], [769, 79.28686946128316]], [[769, 80.28686946128316], [769, 80.10655187586673]], [[769, 80.97008694845346], [769.7791871614327, 81]], [[769, 87.99805661961643], [769.0147690101174, 88]], [[769, 89.12833312002465], [769, 89.28936921188239]], [[769,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
# ---------- end python ----------
python_2 = GhPythonScript(x=python.v_list)  # -> out, lns; inputs x: list
# ---------- python_2: Python ----------
import Rhino.Geometry as rg

lns = []

for pair in x:
    lns.append(rg.Line(
        rg.Point3d(pair[0][0], pair[0][1], 0.),
        rg.Point3d(pair[1][0], pair[1][1], 0.)
    ))
# ---------- end python_2 ----------
panel = Panel(python_2.out)
